# Dynamo graph DefineTypesFromEtabs.dyn (Dynamo 2.5.0.7460)

columns_information = Filename("C:\Users\khaled fathy\Downloads\COLUMN DEFINITIONS.xlsx")  # graph input; frozen
sheet_name_for_columns_info = StringInput("Frame Sec Def - Conc Col Reinf")  # graph input
family_types = FamilyTypes()  # nothing selected; graph input
python_script = Python()
# ---------- python_script.python (248 lines) ----------
import clr
clr.AddReference("RevitNodes")
import Revit
clr.ImportExtensions(Revit.Elements)
clr.AddReference("RevitServices")
import RevitServices
from RevitServices.Persistence import DocumentManager
from System.Collections.Generic import *
# Import RevitAPI
clr.AddReference("RevitAPI")
import Autodesk
from Autodesk.Revit.DB import *
clr.AddReference("ProtoGeometry")
from Autodesk.DesignScript.Geometry import *
clr.AddReference("RevitAPIUI")
from Autodesk.Revit.UI import *
clr.AddReference("System.Windows.Forms")
clr.AddReference("System.Drawing")
from System.Windows.Forms import *
from System.Drawing import *
ud="USERDOMAIN"
import System.Drawing
import System.Windows.Forms
DM = "PROVISION"
DM2 = "CG"
from System.Drawing import *
from System.Windows.Forms import *
import os

doc = DocumentManager.Instance.CurrentDBDocument
uidoc = DocumentManager.Instance.CurrentUIApplication.ActiveUIDocument

Elements = FilteredElementCollector(doc).OfClass(Family).ToElements()
TYPES = []
dic = {}
for m in Elements:
	try:
		
		symbols = list(m.GetFamilySymbolIds())
		for i in symbols:
			#print "Family Type Id =  " + str(i)
			famsymbol = doc.GetElement(i)
			#print "Symbol ID = " + str(famsymbol)
			symbolName = famsymbol.get_Parameter(BuiltInParameter.SYMBOL_NAME_PARAM).AsString()
			typekey = m.Name + ":" +symbolName
			TYPES.append(typekey)
			dic[typekey] = famsymbol
	except:
	    pass


class MainForm(Form):
	
	out = [None, None, None, None, None]
	
	def __init__(self):
		self.InitializeComponent()
	
	def InitializeComponent(self):
		self._button1 = System.Windows.Forms.Button()
		self._button2 = System.Windows.Forms.Button()
		self._button3 = System.Windows.Forms.Button()
		self._comboBox1 = System.Windows.Forms.ComboBox()
		self._textBox1 = System.Windows.Forms.TextBox()
		self._textBox2 = System.Windows.Forms.TextBox()
		self._label1 = System.Windows.Forms.Label()
		self._label2 = System.Windows.Forms.Label()
		self._label3 = System.Windows.Forms.Label()
		self._label4 = System.Windows.Forms.Label()
		self._label5 = System.Windows.Forms.Label()
		self._label6 = System.Windows.Forms.Label()
		self.SuspendLayout()
		# 
		# button1
		# 
		self._button1.Location = System.Drawing.Point(210, 166)
		self._button1.Name = "button1"
		self._button1.Size = System.Drawing.Size(75, 23)
		self._button1.TabIndex = 0
		self._button1.Text = "Apply"
		self._button1.UseVisualStyleBackColor = True
		self._button1.Click += self.Button1Click
		# 
		# button2
		# 
		self._button2.Location = System.Drawing.Point(12, 12)
		self._button2.Name = "button2"
		self._button2.Size = System.Drawing.Size(206, 23)
		self._button2.TabIndex = 1
		self._button2.Text = "Select Columns Information Excel File"
		self._button2.UseVisualStyleBackColor = True
		self._button2.Click += self.Button2Click
		# 
		# button3
		# 
		self._button3.Location = System.Drawing.Point(12, 97)
		self._button3.Name = "button3"
		self._button3.Size = System.Drawing.Size(206, 23)
		self._button3.TabIndex = 2
		self._button3.Text = "Select Columns Sections Excel File"
		self._button3.UseVisualStyleBackColor = True
		self._button3.Click += self.Button3Click
		# 
		# comboBox1
		# 
		self._comboBox1.DropDownStyle = System.Windows.Forms.ComboBoxStyle.DropDownList
		self._comboBox1.FormattingEnabled = True
		self._comboBox1.Location = System.Drawing.Point(248, 71)
		self._comboBox1.Name = "comboBox1"
		self._comboBox1.Size = System.Drawing.Size(235, 21)
		self._comboBox1.TabIndex = 3
		self._comboBox1.Items.AddRange(tuple(TYPES))
		# 
		# textBox1
		# 
		self._textBox1.Location = System.Drawing.Point(248, 45)
		self._textBox1.Name = "textBox1"
		self._textBox1.Size = System.Drawing.Size(235, 20)
		self._textBox1.TabIndex = 4
		# 
		# textBox2
		# 
		self._textBox2.Location = System.Drawing.Point(249, 123)
		self._textBox2.Name = "textBox2"
		self._textBox2.Size = System.Drawing.Size(234, 20)
		self._textBox2.TabIndex = 5
		# 
		# label1
		# 
		self._label1.Location = System.Drawing.Point(249, 97)
		self._label1.Name = "label1"
		self._label1.Size = System.Drawing.Size(234, 23)
		self._label1.TabIndex = 6
		self._label1.Text = "........"
		self._label1.TextAlign = System.Drawing.ContentAlignment.MiddleLeft
		# 
		# label2
		# 
		self._label2.Location = System.Drawing.Point(248, 12)
		self._label2.Name = "label2"
		self._label2.Size = System.Drawing.Size(235, 23)
		self._label2.TabIndex = 7
		self._label2.Text = "........"
		self._label2.TextAlign = System.Drawing.ContentAlignment.MiddleLeft
		# 
		# label3
		# 
		self._label3.Location = System.Drawing.Point(12, 45)
		self._label3.Name = "label3"
		self._label3.Size = System.Drawing.Size(206, 23)
		self._label3.TabIndex = 8
		self._label3.Text = "Sheet name for Columns info:"
		self._label3.TextAlign = System.Drawing.ContentAlignment.MiddleLeft
		# 
		# label4
		# 
		self._label4.Location = System.Drawing.Point(12, 68)
		self._label4.Name = "label4"
		self._label4.Size = System.Drawing.Size(206, 23)
		self._label4.TabIndex = 9
		self._label4.Text = "Select Family Type:"
		self._label4.TextAlign = System.Drawing.ContentAlignment.MiddleLeft
		# 
		# label5
		# 
		self._label5.Location = System.Drawing.Point(12, 123)
		self._label5.Name = "label5"
		self._label5.Size = System.Drawing.Size(206, 23)
		self._label5.TabIndex = 10
		self._label5.Text = "Sheet Name For Columns Sections:"
		self._label5.TextAlign = System.Drawing.ContentAlignment.MiddleLeft
		# 
		# label6
		# 
		self._label6.Font = System.Drawing.Font("Microsoft Sans Serif", 6.5, System.Drawing.FontStyle.Regular, System.Drawing.GraphicsUnit.Point, 0)
		self._label6.Location = System.Drawing.Point(172, 188)
		self._label6.Name = "label6"
		self._label6.Size = System.Drawing.Size(160, 23)
		self._label6.TabIndex = 11
		self._label6.Text = "CG Computational and AI Department"
		self._label6.TextAlign = System.Drawing.ContentAlignment.MiddleCenter
		# 
		# MainForm
		# 
		self.ClientSize = System.Drawing.Size(490, 215)
		self.Controls.Add(self._label6)
		self.Controls.Add(self._label5)
		self.Controls.Add(self._label4)
		self.Controls.Add(self._label3)
		self.Controls.Add(self._label2)
		self.Controls.Add(self._label1)
		self.Controls.Add(self._textBox2)
		self.Controls.Add(self._textBox1)
		self.Controls.Add(self._comboBox1)
		self.Controls.Add(self._button3)
		self.Controls.Add(self._button2)
		self.Controls.Add(self._button1)
		self.FormBorderStyle = System.Windows.Forms.FormBorderStyle.Fixed3D
		self.MaximizeBox = False
		self.MinimizeBox = False
		self.Name = "MainForm"
		self.ShowIcon = False
		self.StartPosition = System.Windows.Forms.FormStartPosition.CenterScreen
		self.Text = "CG_EtabsTypes"
		self.ResumeLayout(False)
		self.PerformLayout()
		self.TopMost = True


	def Button2Click(self, sender, e):
		x = OpenFileDialog()
		x.ShowDialog()
		self._label2.Text = x.FileName

	def Button3Click(self, sender, e):
		x = OpenFileDialog()
		x.ShowDialog()
		self._label1.Text = x.FileName

	def Button1Click(self, sender, e):
		self.out[0] = self._label2.Text
		self.out[1] = self._textBox1.Text
		self.out[2] = dic[self._comboBox1.SelectedItem]
		self.out[3] = self._label1.Text
		self.out[4] = self._textBox2.Text

		self.Close()




##############################################
#    def Imaged(self):
#        return Image(r"C:\Users\amr_abdelkader\Downloads\problem 1 .jpg")
        

        
#5fggg5
       
if os.environ.get(ud) == DM or os.environ.get(ud) == DM2:
	x = MainForm()
	Application.Run(x)
    

	if (MainForm.out[0] != None and MainForm.out[1] != None and MainForm.out[2] != None and MainForm.out[3] != None and MainForm.out[4] != None) :
		OUT=MainForm.out
	else:
		TaskDialog.Show ("CG_EtabsTypes", "Incorrect inputs!" )
# ----------------------------------------
code_block = CodeBlock(n=python_script) { n[0]; n[1]; n[2]; n[3]; n[4]; }

# group: Importing Columns Sections
sheet_name_for_columns_sections = StringInput("Frame Sec Def - Conc Rect")  # graph input
columns_sections = Filename("C:\Users\khaled fathy\Downloads\COLUMNS.xlsx")  # graph input; frozen
file_from_path = FileObject(path=code_block.out3)
importExcel = Data.ImportExcel(file=file_from_path, sheetName=code_block.out4)

file_from_path_2 = FileObject(path=code_block.out0)
importExcel_2 = Data.ImportExcel(file=file_from_path_2, sheetName=code_block.out1)
code_block_2 = CodeBlock(a=importExcel_2) { List.DropItems(a,1); }
transpose = List.Transpose(lists=code_block_2)
get_the_columns_you_need = CodeBlock(name=transpose, numberinx=transpose, numberiny=transpose, bardiam=transpose, stirrupdiam=transpose, cover=transpose) { name[0]; numberinx[6]; numberiny[7]; bardiam[8]; stirrupdiam[10]; cover[5]; }
droping_data_you_don_t_want = CodeBlock(a=get_the_columns_you_need.out0, b=get_the_columns_you_need.out1, c=get_the_columns_you_need.out2, d=get_the_columns_you_need.out3, e=get_the_columns_you_need.out4, f=get_the_columns_you_need.out5)
# ---------- droping_data_you_don_t_want.designscript (6 lines) ----------
names=List.DropItems(a,2);
numberofbarsinx=List.DropItems(b,2);
numberofbarsiny=List.DropItems(c,2);
bardiam=List.DropItems(d,2);
stirrupdiam=List.DropItems(e,2);
cover=List.DropItems(f,2);
# ----------------------------------------
code_block_3 = CodeBlock(a=importExcel) { List.DropItems(a,1); }
transpose_2 = List.Transpose(lists=code_block_3)
get_the_columns_you_need_2 = CodeBlock(A=transpose_2, B=transpose_2, C=transpose_2) { A[0]; B[3]; C[4]; }
droping_data_you_don_t_want_2 = CodeBlock(a=get_the_columns_you_need_2.out0, b=get_the_columns_you_need_2.out1, c=get_the_columns_you_need_2.out2) { names=List.DropItems(a,2); depth=List.DropItems(b,2); width=List.DropItems(c,2); }
code_block_4 = CodeBlock(a=droping_data_you_don_t_want.names, b=droping_data_you_don_t_want_2.names) { List.SetIntersection(a,b); }
eq = droping_data_you_don_t_want.names == code_block_4  # lacing=CrossProduct
boolean = BoolSelector(true)
allIndicesOf = List.AllIndicesOf(list=eq@L2, item=boolean)
code_block_5 = CodeBlock(allindices=allIndicesOf, a=droping_data_you_don_t_want.names, b=droping_data_you_don_t_want.numberofbarsinx, c=droping_data_you_don_t_want.numberofbarsiny, d=droping_data_you_don_t_want.bardiam, e=droping_data_you_don_t_want.stirrupdiam, f=droping_data_you_don_t_want.cover)
# ---------- code_block_5.designscript (7 lines) ----------
x=List.Flatten(allindices);
names=a[x];
numberofbarsinx=b[x];
numberofbarsiny=c[x];
bardiam=d[x];
stirrupdiam=e[x];
cover=f[x];
# ----------------------------------------
string_from_object = FromObject(obj=code_block_5.names)
elementTypes = Python(IN[0]=code_block.out2, IN[1]=string_from_object)
# ---------- elementTypes.python (28 lines) ----------
import clr
clr.AddReference('RevitAPI')
from Autodesk.Revit.DB import *

clr.AddReference("RevitNodes")
import Revit
clr.ImportExtensions(Revit.Elements)

clr.AddReference("RevitServices")
import RevitServices
from RevitServices.Persistence import DocumentManager
from RevitServices.Transactions import TransactionManager

doc = DocumentManager.Instance.CurrentDBDocument
famtype = UnwrapElement(IN[0])
newnames = IN[1]

    
st=[]
TransactionManager.Instance.EnsureInTransaction(doc)
for i in newnames:
    try:
        st.append(famtype.Duplicate(i))
    except:
        st.append("null")
TransactionManager.Instance.TransactionTaskDone()
OUT = st     
        
# ----------------------------------------
code_block_6 = CodeBlock()
# ---------- code_block_6.designscript (8 lines) ----------
"Bar Diameter";
"Stirrup Diameter";
"Cover";
"Column Width";
"Column Depth";
"Bar Radius";
"Y Axis Rebars";
"X Axis Rebars";
# ----------------------------------------
code_block_7 = CodeBlock(a=code_block_5.bardiam, b=code_block_5.stirrupdiam) { bardiam=String.ToNumber(a); stirrups=String.ToNumber(b); }
bar_radius = CodeBlock(b=code_block_7.bardiam) { b*2; }
cover_in_mm = CodeBlock { 26; }
eq_2 = code_block_4 == droping_data_you_don_t_want_2.names  # lacing=CrossProduct
boolean_2 = BoolSelector(true)
allIndicesOf_2 = List.AllIndicesOf(list=eq_2@L2, item=boolean_2)
code_block_8 = CodeBlock(allindices=allIndicesOf_2, w=droping_data_you_don_t_want_2.width, d=droping_data_you_don_t_want_2.depth) { x=List.Flatten(allindices); width=w[x]; depth=d[x]; }
code_block_9 = CodeBlock(w=code_block_8.width, d=code_block_8.depth) { w; d; }
code_block_10 = CodeBlock(eles=elementTypes, param1=code_block_6.out0, val1=bar_radius, param2=code_block_6.out1, val2=code_block_7.stirrups, param3=code_block_6.out2, val3=cover_in_mm, param4=code_block_6.out3, val4=code_block_9.w, param5=code_block_6.out4, val5=code_block_9.d, param6=code_block_6.out5, val6=code_block_7.bardiam, param7=code_block_6.out6, val7=code_block_5.numberofbarsiny, param8=code_block_6.out7, val8=code_block_5.numberofbarsinx)
# ---------- code_block_10.designscript (8 lines) ----------
x=Element.SetParameterByName(eles,param1,val1);
y=Element.SetParameterByName(x,param2,val2);
z=Element.SetParameterByName(y,param3,val3);
m=Element.SetParameterByName(z,param4,val4);
n=Element.SetParameterByName(m,param5,val5);
o=Element.SetParameterByName(n,param6,val6);
p=Element.SetParameterByName(o,param7,val7);
q=Element.SetParameterByName(p,param8,val8);
# ----------------------------------------
python_script_2 = Python(IN[0]=elementTypes)
# ---------- python_script_2.python (52 lines) ----------
import clr
clr.AddReference("RevitNodes")
import Revit
clr.ImportExtensions(Revit.Elements)
clr.AddReference("RevitServices")
import RevitServices
from RevitServices.Persistence import DocumentManager
from System.Collections.Generic import *
# Import RevitAPIt
clr.AddReference("RevitAPI")
import Autodesk
from Autodesk.Revit.DB import *
clr.AddReference("ProtoGeometry")
from Autodesk.DesignScript.Geometry import *
clr.AddReference("RevitAPIUI")
from Autodesk.Revit.UI import *
clr.AddReference("System.Windows.Forms")
clr.AddReference("System.Drawing")
from System.Windows.Forms import *
from System.Drawing import *
FN = "ALFANAR"
import sys
pyt_path = r'C:\Program Files (x86)\IronPython 2.7\Lib'
sys.path.append(pyt_path)
import os
dns=str(os.environ)
SPLITTED=dns.split("USERDNSDOMAIN")
from os.path import *        
import os
from os.path import join
import time
import re
import string
from ctypes import windll
from System.Reflection import Assembly
clr.AddReference("RevitServices")
import RevitServices
from RevitServices.Persistence import DocumentManager
from RevitServices.Transactions import TransactionManager

ud="USERDOMAIN"

OUT=[]
DM = "PROVISION"
DM2 = "CG"

# Get the current document
doc = DocumentManager.Instance.CurrentDBDocument

if os.environ.get(ud) == DM or os.environ.get(ud) == DM2:
    
    OUT = [ os.environ.get( "USERNAME" ),doc.ProjectInformation.BuildingName, len(IN[0])]
# ----------------------------------------
python_script_3 = Python(IN[0]=python_script_2)
# ---------- python_script_3.python (24 lines) ----------
import datetime

def save_xml(xml_data, path):
    with open(path, "w") as f:
        f.write(xml_data)

xml_data = """<?xml version="1.0" encoding="UTF-8"?>
<root>
  <LandscapeGrading>
    <UserName>UserPlaceHolder</UserName>
    <StartDate>DateTimePlaceHolder</StartDate>
    <ProjectName>ProjectPlaceHolder</ProjectName>
    <Discipline>Structure</Discipline>
    <NoOfCreatedElementTypes>hhhh</NoOfCreatedElementTypes>
  </LandscapeGrading>
</root>
"""
now = datetime.datetime.now()

# Assuming IN[0], IN[1], and IN[2] are lists, access the first element of each list
xml_data = xml_data.replace("UserPlaceHolder", IN[0][0]).replace("DateTimePlaceHolder", str(now.strftime("%m/%d/%Y %H:%M:%S"))).replace("ProjectPlaceHolder", IN[0][1]).replace("hhhh", str(IN[0][2]))

path = r"\\192.168.1.200\cg sharing\CG AI\CGDB\CG_EtabsTypes\{}_EtabsTypesDyn.xml".format(str(now.strftime("%Y%m%d%H%M%S%f")))
save_xml(xml_data, path)
# ----------------------------------------
new_types = Watch(elementTypes)  # graph output
code_block_11 = CodeBlock {  }
