# Dynamo graph Q. Data Type Filter to Target Count.dyn (Dynamo 2.10.1.3976)

code_block = CodeBlock()
# ---------- code_block.designscript (2 lines) ----------
///Can be String or Number or Integer
TypeToKeep = "Integer";
# ----------------------------------------
code_block_2 = CodeBlock { "String"; }
eq = code_block == code_block_2
code_block_3 = CodeBlock()
# ---------- code_block_3.designscript (1 lines) ----------
["s_0", 1, 2, 3.5, 4, "s_5", 6.5, 7, 8, 9.5, "s_10", 11, 12.5, 13, "14", "s_15", 16, 17, 18.5, 19, "s_20", 21, 22, 23.5, 24, "s_25", 26.5, 27, 28, 29.5, "s_30", 31, 32, 33.5, 34, "s_35", 36.5, 37, 38, 39.5, "s_40", 41, 42, 43.5, 44, "s_45", 46.5, 47, 48, 49.5, "s_50", 51, 52, 53.5, 54, "s_55", 56.5, 57, 58, 59.5, "s_60", 61, 62, 63.5, 64, "s_65", 66.5, 67, 68, 69.5, "s_70", 71, 72, 73.5, 74, "s_75", 76.5, 77, 78, 79.5, "s_80", 81, 82, 83.5, 84, "s_85", 86.5, 87, 88, 89.5, "s_90", 91, 92, 93.5, 94, "s_95", 96.5, 97, 98, 99.5, "s_100", 101, 102, 103.5, 104, "s_105", 106.5, 107, 108, 109.5, "s_110", 111, 112, 113.5, 114, "s_115", 116.5, 117, 118, 119.5, "s_120", 121, 122, 123.5, 124, "s_125", 126.5, 127, 128, 129.5, "s_130", 131, 132, 133.5, 134, "s_135", 136.5, 137, 138, 139.5, "s_140", 141, 142, 143.5, 144, "s_145", 146.5, 147, 148, 149.5, "s_150", 151, 152, 153.5, 154, "s_155", 156.5, 157, 158, 159.5, "s_160", 161, 162, 163.5, 164, "s_165", 166.5, 167, 168, 169.5, "s_170", 171, 172, 173.5, 174, "s_175", 176.5, 177, 178, 179.5, "s_180", 181, 182, 183.5, 184, "s_185", 186.5, 187, 188, 189.5, "s_190", 191, 192, 193.5, 194, "s_195", 196.5, 197, 198, 199.5, "s_200", 201, 202, 203.5, 204, "s_205", 206.5, 207, 208, 209.5, "s_210", 211, 212, 213.5, 214, "s_215", 216.5, 217, 218, 219.5, "s_220", 221, 222, 223.5, 224, "s_225", 226.5, 227, 228, 229.5, "s_230", 231, 232, 233.5, 234, "s_235", 236.5, 237, 238, 239.5, "s_240", 241, 242, 243.5, 244, "s_245", 246.5, 247, 248, 249.5, "s_250", 251, 252, 253.5, 254, "s_255", 256.5, 257, 258, 259.5, "s_260", 261, 262, 263.5, 264, "s_265", 266.5, 267, 268, 269.5, "s_270", 271, 272, 273.5, 274, "s_275", 276.5, 277, 278, 279.5, "s_280", 281, 282, 283.5, 284, "s_285", 286.5, 287, 288, 289.5, "s_290", 291, 292, 293.5, 294, "s_295", 296.5, 297, 298, 299.5, "s_300", 301, 302, 303.5, 304, "s_305", 306.5, 307, 308, 309.5, "s_310", 311, 312, 313.5, 314, "s_315", 316.5, 317, 318, 319.5, "s_320", 321, 322, 323.5, 324, "s_325", 326.5, 327, 328, 329.5, "s_330", 331, 332, 333.5, 334, "s_335", 336.5, 337, 338, 339.5, "s_340", 341, 342, 343.5, 344, "s_345", 346.5, 347, 348, 349.5, "s_350", 351, 352, 353.5, 354, "s_355", 356.5, 357, 358, 359.5, "s_360", 361, 362, 363.5, 364, "s_365", 366.5, 367, 368, 369.5, "s_370", 371, 372, 373.5, 374, "s_375", 376.5, 377, 378, 379.5, "s_380", 381, 382, 383.5, 384, "s_385", 386.5, 387, 388, 389.5, "s_390", 391, 392, 393.5, 394, "s_395", 396.5, 397, 398, 399.5, "s_400", 401, 402, 403.5, 404, "s_405", 406.5, 407, 408, 409.5, "s_410", 411, 412, 413.5, 414, "s_415", 416.5, 417, 418, 419.5, "s_420", 421, 422, 423.5, 424, "s_425", 426.5, 427, 428, 429.5, "s_430", 431, 432, 433.5, 434, "s_435", 436.5, 437, 438, 439.5, "s_440", 441, 442, 443.5, 444, "s_445", 446.5, 447, 448, 449.5, "s_450", 451, 452, 453.5, 454, "s_455", 456.5, 457, 458, 459.5, "s_460", 461, 462, 463.5, 464, "s_465", 466.5, 467, 468, 469.5, "s_470", 471, 472, 473.5, 474, "s_475", 476.5, 477, 478, 479.5, "s_480", 481, 482, 483.5, 484, "s_485", 486.5, 487, 488, 489.5, "s_490", 491, 492, 493.5, 494, "s_495", 496.5, 497, 498, 499.5, "s_500", 501, 502, 503.5, 504, "s_505", 506.5, 507, 508, 509.5, "s_510", 511, 512, 513.5, 514, "s_515", 516.5, 517, 518, 519.5, "s_520", 521, 522, 523.5, 524, "s_525", 526.5, 527, 528, 529.5, "s_530", 531, 532, 533.5, 534, "s_535", 536.5, 537, 538, 539.5, "s_540", 541, 542, 543.5, 544, "s_545", 546.5, 547, 548, 549.5, "s_550", 551, 552, 553.5, 554, "s_555", 556.5, 557, 558, 559.5, "s_560", 561, 562, 563.5, 564, "s_565", 566.5, 567, 568, 569.5, "s_570", 571, 572, 573.5, 574, "s_575", 576.5, 577, 578, 579.5, "s_580", 581, 582, 583.5, 584, "s_585", 586.5, 587, 588, 589.5, "s_590", 591, 592, 593.5, 594, "s_595", 596.5, 597, 598, 599.5, "s_600", 601, 602, 603.5, 604, "s_605", 606.5, 607, 608, 609.5, "s_610", 611, 612, 613.5, 614, "s_615", 616.5, 617, 618, 619.5, "s_620", 621, 622, 623.5, 624, "s_625", 626.5, 627, 628, 629.5, "s_630", 631, 632, 633.5, 634, "s_635", 636.5, 637, 638, 639.5, "s_640", 641, 642, 643.5, 644, "s_645", 646.5, 647, 648, 649.5, "s_650", 651, 652, 653.5, 654, "s_655", 656.5, 657, 658, 659.5, "s_660", 661, 662, 663.5, 664, "s_665", 666.5, 667, 668, 669.5, "s_670", 671, 672, 673.5, 674, "s_675", 676.5, 677, 678, 679.5, "s_680", 681, 682, 683.5, 684, "s_685", 686.5, 687, 688, 689.5, "s_690", 691, 692, 693.5, 694, "s_695", 696.5, 697, 698, 699.5, "s_700", 701, 702, 703.5, 704, "s_705", 706.5, 707, 708, 709.5, "s_710", 711, 712, 713.5, 714, "s_715", 716.5, 717, 718, 719.5, "s_720", 721, 722, 723.5, 724, "s_725", 726.5, 727, 728, 729.5, "s_730", 731, 732, 733.5, 734, "s_735", 736.5, 737, 738, 739.5, "s_740", 741, 742, 743.5, 744, "s_745", 746.5, 747, 748, 749.5, "s_750", 751, 752, 753.5, 754, "s_755", 756.5, 757, 758, 759.5, "s_760", 761, 762, 763.5, 764, "s_765", 766.5, 767, 768, 769.5, "s_770", 771, 772, 773.5, 774, "s_775", 776.5, 777, 778, 779.5, "s_780", 781, 782, 783.5, 784, "s_785", 786.5, 787, 788, 789.5, "s_790", 791, 792, 793.5, 794, "s_795", 796.5, 797, 798, 799.5, "s_800", 801, 802, 803.5, 804, "s_805", 806.5, 807, 808, 809.5, "s_810", 811, 812, 813.5, 814, "s_815", 816.5, 817, 818, 819.5, "s_820", 821, 822, 823.5, 824, "s_825", 826.5, 827, 828, 829.5, "s_830", 831, 832, 833.5, 834, "s_835", 836.5, 837, 838, 839.5, "s_840", 841, 842, 843.5, 844, "s_845", 846.5, 847, 848, 849.5, "s_850", 851, 852, 853.5, 854, "s_855", 856.5, 857, 858, 859.5, "s_860", 861, 862, 863.5, 864, "s_865", 866.5, 867, 868, 869.5, "s_870", 871, 872, 873.5, 874, "s_875", 876.5, 877, 878, 879.5, "s_880", 881, 882, 883.5, 884, "s_885", 886.5, 887, 888, 889.5, "s_890", 891, 892, 893.5, 894, "s_895", 896.5, 897, 898, 899.5, "s_900", 901, 902, 903.5, 904, "s_905", 906.5, 907, 908, 909.5, "s_910", 911, 912, 913.5, 914, "s_915", 916.5, 917, 918, 919.5, "s_920", 921, 922, 923.5, 924, "s_925", 926.5, 927, 928, 929.5, "s_930", 931, 932, 933.5, 934, "s_935", 936.5, 937, 938, 939.5, "s_940", 941, 942, 943.5, 944, "s_945", 946.5, 947, 948, 949.5, "s_950", 951, 952, 953.5, 954, "s_955", 956.5, 957, 958, 959.5, "s_960", 961, 962, 963.5, 964, "s_965", 966.5, 967, 968, 969.5, "s_970", 971, 972.5, 973, 974, "s_975", 976, 977, 978, 979.5, "s_980", 981, 982, 983.5, 984, "s_985", 986.5, 987, 988, 989.5, "s_990", 991, 992, 993.5, 994, "s_995", 996.5, 997, 998, 999.5];
# ----------------------------------------
type = Object.Type(obj=code_block_3)
code_block_4 = CodeBlock(x=type) { x=="System.String"; }
filterByBoolMask = List.FilterByBoolMask(list=code_block_3, mask=code_block_4)
code_block_5 = CodeBlock { "Number"; }
eq_2 = code_block == code_block_5
code_block_6 = CodeBlock(x=type) { x=="System.Double"; }
filterByBoolMask_2 = List.FilterByBoolMask(list=code_block_3, mask=code_block_6)
code_block_7 = CodeBlock { "Integer"; }
eq_3 = code_block == code_block_7
code_block_8 = CodeBlock(x=type) { x=="System.Int64"; }
filterByBoolMask_3 = List.FilterByBoolMask(list=code_block_3, mask=code_block_8)
code_block_9 = CodeBlock { null; }
if_ = If(test=eq_3, true=filterByBoolMask_3.in, false=code_block_9)
if_2 = If(test=eq_2, true=filterByBoolMask_2.in, false=if_)
if_3 = If(test=eq, true=filterByBoolMask.in, false=if_2)
code_block_10 = CodeBlock(output=if_3) { output; }
code_block_11 = CodeBlock()
# ---------- code_block_11.designscript (54 lines) ----------
// ###Q2 — Data Type Filter to Target Count
// **[CH1 – Data Types]**
//
// In this challenge, you are given **one mixed list** that contains three kinds of data:
//
// - **Integers** (whole numbers like 5, 12, 201, …)
// - **Decimal numbers** (numbers with fractions like 3.5, 7.25, …)
// - **Strings** (text like `"Room A"`, `"North"`, …)
//
// In the Dynamo file, you will find:
//
// - A **mixed input list** (already prepared).
// - A string input called **`TypeToKeep`** – this is a text field where *you* manually type which data type you want to keep.
//
// `TypeToKeep` can be one of the following options (typed as text):
//
// - `"Integer"`
// - `"Number"` (for decimal numbers)
// - `"String"`
//
// ---
//
// #### Task
//
// Build a small logic that:
//
// 1. **Checks the data type** of every item in the mixed list.
// 2. Based on the value in `TypeToKeep`, creates a **boolean mask** (a list of `true/false`):
//    - Items matching the chosen type → `true`
//    - All other items → `false`
// 3. Uses this mask to **filter** the original mixed list, so the **filtered list** contains only items of the selected type.
// 4. Calculates the **count** of the filtered list.
//
// In this quiz, you are told that there exists **one correct filtered list** that we are looking for, with:
//
// - ✅ A total **count of 201 items**
// - ✅ All items are of **one single data type**
//
// ---
//
// #### Challenge
//
// > Change the value of `TypeToKeep` (try `"Integer"`, `"Number"`, `"String"`) and re-run the graph until
// > **`Count(filteredList) == 201`**.
//
// ---
//
// #### Quiz Question
//
// When you reached a filtered list with **exactly 201 items**,
//
// **what value did you write in `TypeToKeep`?**
//
// (Answer with exactly one word: `Integer`, `Number`, or `String`.)
# ----------------------------------------
